# Grasshopper definition Elvis_MissionControl_1.0.gh (Grasshopper 0.9.75)
# Copyright: All Rights Reserved

eeht = Slider(0, range=0..200)
Z = UnitZ(Factor=eeht)
crv_path = Curve(<curve referenced from the Rhino model>)
move = Move(Geometry=crv_path, Motion=Z)  # -> Geometry, Transform
cp = ControlPoints(Curve=move.Geometry)  # -> Points, Weights, Knots
divide = DivideCurve(Curve=move.Geometry, Count=Slider(12, range=2..50), Kinks=False)  # -> Points, Tangents, Parameters
xz = XZPlane(Origin=divide.Points)

# ---- group: gCode
axis1 = Slider(0, range=-90..90)
axis2 = Slider(0, range=-75..75)
axis3 = Slider(0, range=-90..90)
axis4 = Slider(0, range=-150..150)
axis5 = Slider(0, range=-90..90)
axis6 = Slider(0, range=-150..150)
connect = BooleanToggle(False)
merge = Merge(Data1=axis1, Data2=axis2, Data3=axis3, Data4=axis4, Data5=axis5, Data6=axis6)
Q = CSharpScript(X=connect, Reference="C:\Users\Suryansh Chandra\SkyDrive\Works\2014_robotics\Software\Dynamixel_64bit\Robotis.dll")  # -> out; inputs X: Boolean
# ---------- Q: C# ----------
    if (X)
    {
      if(dynamixel.dxl_initialize(DEFAULT_PORTNUM, DEFAULT_BAUDNUM) == 0)
      {
        Print("can't find Elvis :(");
        return;
      }
      Print("Elvis is online!");
    }
    else
    {
      dynamixel.dxl_terminate();
      Print("offline");
    }

    //dynamixel.dxl_write_word(8, 30, 0);
# ---------- Q: C# additional code ----------
  const int DEFAULT_PORTNUM = 4; //com6
  const int DEFAULT_BAUDNUM = 1; //1mbps
# ---------- end Q ----------
panel = Panel(Q)

# ----
planetrees = Plane(flatten(xz))
poly_homeplane = Curve(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)
home = CSharpScript(C=poly_homeplane)  # -> out, P; inputs C: Polyline; same code as c_script
c_script = CSharpScript(P=planetrees, H=home.P, D="2")  # -> out, R0, R1; inputs P: list of Plane, H: Plane, D: Double
# ---------- c_script: C# ----------
    Plane stPln = P[0];
    int divCount = Convert.ToInt32(stPln.Origin.DistanceTo(H.Origin) / D);
    double inc = 1f / (stPln.Origin.DistanceTo(H.Origin) / D);

    Line lno = new Line(H.Origin, stPln.Origin);
    Line lnx = new Line(H.Origin + H.XAxis, stPln.Origin + stPln.XAxis);
    Line lny = new Line(H.Origin + H.YAxis, stPln.Origin + stPln.YAxis);

    List<Plane> data0 = new List<Plane>();
    for(double i = 0;i < 1;i += inc)
      data0.Add(new Plane(lno.PointAt(i), lnx.PointAt(i), lny.PointAt(i)));
    R0 = data0;

    //-----------------------------------------------------

    Plane enPln = P[P.Count - 1];
    divCount = Convert.ToInt32(enPln.Origin.DistanceTo(H.Origin) / D);
    inc = 1f / (enPln.Origin.DistanceTo(H.Origin) / D);
    lno = new Line(enPln.Origin, H.Origin);
    lnx = new Line(enPln.Origin + enPln.XAxis, H.Origin + H.XAxis);
    lny = new Line(enPln.Origin + enPln.YAxis, H.Origin + H.YAxis);
    List<Plane> data1 = new List<Plane>();
    for(double i = inc;i <= 1;i += inc)
      data1.Add(new Plane(lno.PointAt(i), lnx.PointAt(i), lny.PointAt(i)));
    R1 = data1;
# ---------- end c_script ----------
merge_2 = Merge(Data1=flatten(c_script.R0), Data2=flatten(planetrees), Data3=flatten(c_script.R1))
pline = PolyLine(Vertices=planetrees, Closed=False)
speed_mm_s = Slider(50, range=0..100)
explode = Explode(Curve=pline, Recursive=True)  # -> Segments, Vertices
poly_arbitplane = Curve(<curve referenced from the Rhino model>)
len = Length(Curve=explode.Segments)
rest = CSharpScript(C=poly_arbitplane)  # -> out, P; inputs C: Polyline; same code as c_script
division = Division(A=len, B=speed_mm_s)  # -> flatten(Result)

# ---- group: previewControl
framesequnce = Slider(1, range=0..1)
list = ValueList({"perAxis": 0, "planeFollow": 1, "toolPath": 2}, selected="toolPath")
mesh_elvisparts = Mesh([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])
manualangles = Number(merge)
line_elvisaxes = Line([Line((294.8811579, 243.7372398, -121.1122673), (294.8811579, 243.7372398, 562.9017263)), Line((178.5183633, 243.7372398, 122.9232283), (413.0439524, 243.7372398, 122.9232283)), Line((206.2376293, 243.7372398, 424.9064109), (410.2080638, 243.7372398, 424.9064109)), Line((343.8669332, 110.9712393, 430.9064109), (343.8669332, 568.2514789, 430.9064109)), Line((435.8669332, 477.1638917, 430.9064109), (251.8669332, 477.1638917, 430.9064109)), Line((343.8669332, 402.0161753, 430.9064109), (343.8669332, 592.2688686, 430.9064109))])
mode = Integer(list)

# ----
mode_2 = Integer(list)
c_script_2 = CSharpScript(X=mode_2)  # -> R; inputs X: Int32
# ---------- c_script_2: C# ----------
    if (X > 0) X -= 1;
    R = X;
# ---------- end c_script_2 ----------

filter = StreamFilter(Gate=list, Stream1="-1", Stream2=division)
filter_2 = StreamFilter(Gate=list, Stream1=rest.P, Stream2=planetrees)

elvis_ik = IKSolverForElvis(target_frame=filter_2)  # -> target_frame_6, resultframe_2, D

c_script_3 = CSharpScript(t=filter)  # -> eta; inputs t: list of Double
# ---------- c_script_3: C# ----------
    double sum = 0;
    foreach(double val in t) sum += val;
    sum *= 1.25;
    double ms = sum - Math.Round(sum);

    if (sum >= 0)
    {
      System.TimeSpan time = new System.TimeSpan(0, 0, 0, Convert.ToInt32(sum), Convert.ToInt32(ms * 1000));
      Print(time.ToString());
    }
# ---------- end c_script_3 ----------
time = Number(filter)
runtime = Panel(c_script_3)

resultframe = Plane(elvis_ik.resultframe_2)
split = CSharpScript(D=elvis_ik.D)  # -> out, A, S, P; inputs D: tree
# ---------- split: C# ----------
    int[] lastPath = D.Path(D.BranchCount - 1).Indices;
    int lastCount = lastPath[lastPath.Length - 1];

    DataTree<double> angles = new DataTree<double>();
    DataTree<bool> status = new DataTree<bool>();
    DataTree<Plane> planes = new DataTree<Plane>();
    for(int j = 0;j <= lastCount;j++)
    {
      GH_Path path = new GH_Path(new int[]{0,j});
      //List<double> angList = new List<double>();
      int state = 0;
      for(int i = 0;i < 6;i++)
      {
        int[] path1 = {i,j};
        double ang = 0;
        GH_Convert.ToDouble(D.Branch(path1)[2], out ang, GH_Conversion.Primary);
        angles.Add(ang * 180.0 / Math.PI, path);

        int st;
        GH_Convert.ToInt32(D.Branch(path1)[1], out st, GH_Conversion.Both);
        state += st;

        if (i == 5)
        {
          Plane pln = new Plane();
          GH_Convert.ToPlane(D.Branch(path1)[0], ref pln, GH_Conversion.Both);
          planes.Add(pln, path);
        }
      }
      if (state == 0) status.Add(true, path);
      else status.Add(false, path);

      //cull bad frames
      //if (X) {if (state == 0) angles.AddRange(angList, path);}
      //else angles.AddRange(angList, path);
    }
    A = angles;
    S = status;
    P = planes;
# ---------- end split ----------

cullbadframes = BooleanToggle(False)
num_degreeangles = Number(split.A)
data_ik = Data(elvis_ik.D)
bool = Boolean(split.S)
cluster = Cluster_2(data=num_degreeangles, bool=bool)
cluster_2 = Cluster(data=data_ik, bool=bool)
filter_3 = StreamFilter(Gate=cullbadframes, Stream0=num_degreeangles, Stream1=cluster)
filter_4 = StreamFilter(Gate=cullbadframes, Stream0=data_ik, Stream1=cluster_2)
num_degreeangles_2 = Number(filter_3)
data_ik_2 = Data(filter_4)

# ---- group: gCode (continued)
num_degreeangles_3 = Number(num_degreeangles_2)
time_2 = Number(expr("x*1000", time))
home_2 = CSharpScript(D=num_degreeangles_3, R=graft(time_2))  # -> D1; inputs D: tree of Double, R: tree
# ---------- home_2: C# ----------
    if (D.BranchCount > 1)
    {
      double[] vals = {0,0,0,0,0,0};
      D.AddRange(vals, R.Path(R.BranchCount - 1));
    }
    D1 = D;
# ---------- end home_2 ----------
lng = ListLength(List=time_2)  # -> expr("x-1", Length)
cull_i = CullIndex(List=time_2, Indices=["0", lng], Wrap=True)  # -> flatten(List)
merge_3 = Merge(Data1="2500", Data2=cull_i, Data3="2500")  # -> graft(Result)
c_script_4 = CSharpScript(X=mode_2)  # -> R; inputs X: Int32
# ---------- c_script_4: C# ----------
    if (X > 1) X -= 1;
    R = X;
# ---------- end c_script_4 ----------
filter_5 = StreamFilter(Gate=c_script_4, Stream0=merge, Stream1=home_2)
filter_6 = StreamFilter(Gate=c_script_2, Stream0="-1", Stream1=merge_3)
deg2bytes = DegreesToBytes(A=filter_5)
elvis_io = CSharpScript(
    X=connect,
    B=deg2bytes,
    T=filter_6,
    Reference="C:\Users\Suryansh Chandra\SkyDrive\Works\2014_robotics\Software\Dynamixel_64bit\Robotis.dll")  # -> out; inputs X: Boolean, B: list of Int32, T: Int32
# ---------- elvis_io: C# ----------
    if (!X) return;
    if (B.Count != 6)
    {
      Print("B.Count != 6");
      return;
    }

    //limit goalPos values
    for(int i = 0;i < B.Count;i++) B[i] = Math.Max(0, Math.Min(1023, B[i]));
    B[3] = Math.Max(0, B[3] - 2);

    //move
    moveInTime(1, B[0], T);
    moveInTime(2, 1023 - B[0], T);
    moveInTime(3, 1023 - B[1], T);
    moveInTime(4, B[1], T);
    moveInTime(5, B[2], T);
    moveInTime(6, B[3], T);
    moveInTime(7, B[4], T);
    moveInTime(8, B[5], T);
    if (T > 0) System.Threading.Thread.Sleep(T);
# ---------- elvis_io: C# additional code ----------
  static int[] setSpeeds = {75,75,63,63,75,127,255,255};
  const int AXIS_2_COMPENSATION = 43;
  const int AXIS_3_COMPENSATION = 126;
  const int DEFAULT_PORTNUM = 4;
  const int DEFAULT_BAUDNUM = 1;
  
  const double AX12A_RPM = 114.0;
  const double MAX_VEL = AX12A_RPM * 1024.0 / 60000.0;
  
  public void moveInTime(int id, int goalPos, int time)
  {
    //persistent connection
    if (dynamixel.dxl_get_result() == 2)
    {
      dynamixel.dxl_terminate();
      dynamixel.dxl_initialize(DEFAULT_PORTNUM, DEFAULT_BAUDNUM);
    }

    //axis-2 compensation
    if (id == 3) goalPos = Math.Max(0, goalPos + AXIS_2_COMPENSATION);
    if (id == 4) goalPos = Math.Max(0, goalPos - AXIS_2_COMPENSATION);
    //axis-3 compensation
    if (id == 5) goalPos = Math.Max(0, goalPos - AXIS_3_COMPENSATION);

    //compute & set speed
    int currPos = dynamixel.dxl_read_word(id, 36);
    int posDiff = goalPos - currPos;
    double reqVel = Math.Abs(posDiff) / Convert.ToDouble(time);
    int velInt = Convert.ToInt32(1024 * reqVel / MAX_VEL);
    velInt = (velInt < 0 ? 0 : velInt);
    velInt = (velInt > 1023 ? 1023 : velInt);
    if (time > 0) dynamixel.dxl_write_word(id, 32, velInt);
    else dynamixel.dxl_write_word(id, 32, setSpeeds[id - 1]);

    Print("id:{4}, currPos:{0}, posDiff:{1}, reqVel:{2}, velInt{3}",
      currPos.ToString(), posDiff.ToString(), reqVel.ToString(), velInt.ToString(), id.ToString());

    //set position
    dynamixel.dxl_write_word(id, 30, goalPos);
  }
# ---------- end elvis_io ----------
panel_2 = Panel(elvis_io)

# ---- group: previewControl (continued)
disp_body = CSharpScript(X=mode, D=data_ik_2, M=mesh_elvisparts, L=line_elvisaxes, N=framesequnce, A=manualangles)  # inputs X: Int32, D: tree, M: list of Mesh, L: list of Line, N: Double, A: list of Double
# ---------- disp_body: C# ----------
    body = new Mesh();
    body.Append(M[0]);
    mat = new Rhino.Display.DisplayMaterial(BODY_COL, BODY_ALPHA);
    int frameCount = Convert.ToInt32(D.BranchCount / 6f);
    int index = Math.Min(Convert.ToInt32(N * Convert.ToDouble(frameCount)), frameCount - 1);

    Transform xf = Transform.Identity;
    for(int i = 0;i < 6;i++)
    {
      double angle;
      if (X != 0)
      {
        int[] path = {i,index};
        GH_Convert.ToDouble(D.Branch(path)[2], out angle, GH_Conversion.Primary);
      }
      else angle = RhinoMath.ToRadians(A[i]);
      Transform xf1 = Transform.Rotation(angle, L[i].Direction, L[i].From);
      xf = Transform.Multiply(xf, xf1);
      Mesh temp = M[i + 1].DuplicateMesh();
      temp.Transform(xf);
      body.Append(temp);
    }

    bb = body.GetBoundingBox(false);
    bb.Inflate(50);
# ---------- disp_body: C# additional code ----------
  //colors
  static System.Drawing.Color BODY_COL = System.Drawing.Color.White;
  static double BODY_ALPHA = 0.15;

  //dynamic variables
  static Mesh body;
  static BoundingBox bb;
  static Rhino.Display.DisplayMaterial mat;


  //Return a BoundingBox that contains all the geometry you are about to draw.
  public override BoundingBox ClippingBox
    {get{return bb;}}

  //Draw all meshes in this method.
  public override void DrawViewportMeshes(IGH_PreviewArgs args)
  {
    args.Display.DrawMeshShaded(body, mat);
    args.Display.DrawMeshWires(body, Color.Black, 2);
  }

  //Draw all wires and points in this method.
  public override void DrawViewportWires(IGH_PreviewArgs args)
  {
  }
# ---------- end disp_body ----------
disp_axes = CSharpScript(X=mode, D=data_ik_2, N=framesequnce, L=line_elvisaxes, A=manualangles)  # inputs X: Int32, D: tree, N: Double, L: list of Line, A: list of Double
# ---------- disp_axes: C# ----------
    axes = new Line[6];
    textPos = new Point3d[6];
    status = new int[6];
    angles = new double[6];
    bb = new BoundingBox();
    int frameCount = Convert.ToInt32(D.BranchCount / 6f);
    int index = Math.Min(Convert.ToInt32(N * Convert.ToDouble(frameCount)), frameCount - 1);

    if (X != 0)
    {
      for(int i = 0;i < 6;i++)
      {
        int[] path = {i,index};
        Plane pln = Plane.Unset;
        GH_Convert.ToPlane(D.Branch(path)[0], ref pln, GH_Conversion.Primary);
        if (i != 4) axes[i] = new Line(pln.Origin, pln.ZAxis, AXIS_LENGTH[i]);
        else axes[i] = new Line(pln.Origin, pln.XAxis, AXIS_LENGTH[i]);
        textPos[i] = axes[i].PointAt(AXIS_POS[i]);
        bb.Union(axes[i].From);
        bb.Union(axes[i].To);

        GH_Convert.ToInt32(D.Branch(path)[1], out status[i], GH_Conversion.Primary);
        GH_Convert.ToDouble(D.Branch(path)[2], out angles[i], GH_Conversion.Primary);
        angles[i] = Math.Round(RhinoMath.ToDegrees(angles[i]), 2);
      }
    }
    else
    {
      Plane[] planes = GetPlanes(L);
      for(int i = 0;i < 5;i++)
      {
        Transform xf = Transform.Rotation(RhinoMath.ToRadians(A[i]), planes[i].ZAxis, planes[i].Origin);
        for(int j = (i + 1);j < 6;j++) planes[j].Transform(xf);
      }

      for(int i = 0;i < 6;i++)
      {
        axes[i] = new Line(planes[i].Origin, planes[i].ZAxis, AXIS_LENGTH[i]);
        textPos[i] = axes[i].PointAt(AXIS_POS[i]);
        angles[i] = A[i];
        bb.Union(axes[i].From);
        bb.Union(axes[i].To);
      }
    }

    bb.Inflate(50);
# ---------- disp_axes: C# additional code ----------
  static double[] AXIS_LENGTH = {-150, 150, 150, -450, -150, 200};
  static double[] AXIS_POS = {0.78, 0.63, 0.63, 0.95, 0.88, 1.0};

  //colors
  static System.Drawing.Color GOOD_AXIS = System.Drawing.Color.FromArgb(0, 0, 255);
  static System.Drawing.Color GOOD_TEXT = System.Drawing.Color.FromArgb(0, 127, 255);
  static System.Drawing.Color BAD_AXIS = System.Drawing.Color.FromArgb(170, 0, 0);
  static System.Drawing.Color BAD_TEXT = System.Drawing.Color.FromArgb(255, 0, 0);

  //dashed Lines & txt
  const double DASH_LENGTH = 15;
  const double GAP_LENGTH = DASH_LENGTH * 0.33;
  const double DOT_LENGTH = GAP_LENGTH * 0.33;
  const double SEG_LENGTH = DASH_LENGTH + GAP_LENGTH + DOT_LENGTH + GAP_LENGTH;
  const double DASH_PARAM = DASH_LENGTH / SEG_LENGTH;
  const double GAP_PARAM = GAP_LENGTH / SEG_LENGTH;
  const double DOT_PARAM = DOT_LENGTH / SEG_LENGTH;

  const int TXT_HT = 16;
  const int LINE_THK = 2;


  //dynamic variables
  static Line[] axes;
  static Point3d[] textPos;
  static int[] status;
  static double[] angles;
  static BoundingBox bb;


  //Return a BoundingBox that contains all the geometry you are about to draw.
  public override BoundingBox ClippingBox
    {get{return bb;}}

  //Draw all meshes in this method.
  public override void DrawViewportMeshes(IGH_PreviewArgs args)
  {
  }

  //Draw all wires and points in this method.
  public override void DrawViewportWires(IGH_PreviewArgs args)
  {
    for(int i = 0;i < 6;i++)
    {
      Color col0 = (status[i] == 0 ? GOOD_AXIS : BAD_AXIS);
      args.Display.DrawLines(MakeLineDashed(axes[i]).ToArray(), col0, LINE_THK);

      Color col1 = (status[i] == 0 ? GOOD_TEXT : BAD_TEXT);
      args.Display.Draw2dText("axis_" + (i + 1).ToString() + ":" + angles[i].ToString() + "°", col1, textPos[i], true, TXT_HT, "Arial Bold");
    }
  }

  public Plane[] GetPlanes(List <Line> L)
  {
    Plane[] planes = new Plane[6];
    planes[0] = new Plane(new Point3d(L[0].From.X, L[0].From.Y, 0), Vector3d.XAxis, Vector3d.YAxis);
    planes[1] = new Plane(L[1].To, L[3].Direction, L[0].Direction);
    planes[1].Translate(planes[1].ZAxis * -69.363);
    planes[2] = new Plane(L[2].To, L[3].Direction, L[0].Direction);
    planes[2].Translate(planes[2].ZAxis * -66.341);
    planes[3] = new Plane(L[3].From, L[1].Direction, L[0].Direction);
    planes[3].Translate(planes[3].ZAxis * -366.193);
    planes[3].Flip();
    planes[4] = new Plane(L[4].From, L[3].Direction, L[0].Direction);
    planes[4].Translate(planes[4].ZAxis * -92);
    planes[4].Flip();
    planes[5] = new Plane(planes[3].Origin, L[1].Direction, L[0].Direction);
    planes[5].Flip();
    return planes;
  }



  public List<Line> MakeLineDashed(Line L)
  {
    double segIncrement = 1.0 / Math.Round(L.Length / SEG_LENGTH, 0);
    double dashIncrement = segIncrement * DASH_PARAM;
    double gapIncrement = segIncrement * GAP_PARAM;
    double dotIncrement = segIncrement * DOT_PARAM;

    List<Line> data = new List<Line>();
    for(double param = 0;param <= 1;param += segIncrement)
    {
      data.Add(new Line(L.PointAt(param), L.PointAt(param + dashIncrement)));
      data.Add(new Line(L.PointAt(param + dashIncrement + gapIncrement), L.PointAt(param + dashIncrement + gapIncrement + dotIncrement)));
    }
    return data;
  }
# ---------- end disp_axes ----------

# ----
dispatch = Dispatch(List=elvis_ik.target_frame_6, DispatchPattern=split.S)  # -> ListA, ListB
preview = CustomPreview(
    Geometry=dispatch.ListA,
    Shader={ambient=RGB(128, 128, 128), diffuse=RGB(0, 255, 55), emission=RGB(0, 76, 16), shine=0.5, specular=RGB(255, 255, 255), transparency=0})
preview_2 = CustomPreview(
    Geometry=dispatch.ListB,
    Shader={ambient=RGB(128, 128, 128), diffuse=RGB(255, 0, 0), emission=RGB(76, 0, 0), shine=0.5, specular=RGB(255, 255, 255), transparency=0})

panel_3 = Panel(num_degreeangles_2)

# ==== cluster DegreesToBytes: Convert Degrees to Bytes
A = ClusterInput()
A_2 = Number(A)
item = ListItem(List=A_2, Index=0, Wrap=True)
item_2 = ListItem(List=A_2, Index=1, Wrap=True)
item_3 = ListItem(List=A_2, Index=2, Wrap=True)
item_4 = ListItem(List=A_2, Index=3, Wrap=True)
item_5 = ListItem(List=A_2, Index=4, Wrap=True)
item_6 = ListItem(List=A_2, Index=5, Wrap=True)
remap = RemapNumbers(Value=item, Source="-90 to 90", Target="0 to 1023")  # -> expr("Round(x)", Mapped), Clipped
remap_2 = RemapNumbers(Value=item_2, Source="-75 to 75", Target="0 to 1023")  # -> expr("Round(x)", Mapped), Clipped
remap_3 = RemapNumbers(Value=item_3, Source="-90 to 90", Target="0 to 1023")  # -> expr("Round(x)", Mapped), Clipped
remap_4 = RemapNumbers(Value=item_4, Source="-150 to 150", Target="0 to 1023")  # -> expr("Round(x)", Mapped), Clipped
remap_5 = RemapNumbers(Value=item_5, Source="-90 to 90", Target="0 to 1023")  # -> expr("Round(x)", Mapped), Clipped
remap_6 = RemapNumbers(Value=item_6, Source="-150 to 150", Target="0 to 1023")  # -> expr("Round(x)", Mapped), Clipped
merge = Merge(
    Data1=remap.Mapped,
    Data2=remap_2.Mapped,
    Data3=remap_3.Mapped,
    Data4=remap_4.Mapped,
    Data5=remap_5.Mapped,
    Data6=remap_6.Mapped)
B = ClusterOutput(merge)

# ==== cluster IKSolverForElvis: Solves Inverse Kinematics for Elvis
target_frame = ClusterInput()

# ---- group: IK Solving
# Distance from
# targetFrame.Origin
# to wristCenter.
panel = Panel("0")

target_frame_2 = Plane(graft(target_frame))
points = PointList(Points=flatten(target_frame_2), Size=8)
deplane = DeconstructPlane(Plane=target_frame_2)  # -> Origin, XAxis, YAxis, ZAxis
limitrot = BooleanToggle(True)
vdis = VectorDisplay(Anchor=deplane.Origin, Vector=deplane.ZAxis)
crv_baseplane = Curve(<curve referenced from the Rhino model>)
num_dist = Number(panel)
crv_spine = Curve(<curve referenced from the Rhino model>)

# ---- group: Setup
poly_baseplane = Curve(crv_baseplane)
target_frame_3 = Plane(target_frame_2)
num_dist_2 = Number(num_dist)
addition = Addition(A=num_dist_2, B="70.3")
subtraction = Subtraction(A=num_dist_2, B="70.3")
pt = PointOriented(BasePlane=target_frame_3, UComponent=0, VComponent=0, WComponent=addition)
poly_spine = Curve(crv_spine)
pt_2 = PointOriented(BasePlane=target_frame_3, UComponent=0, VComponent=0, WComponent=subtraction)
c_script = CSharpScript(C=poly_baseplane)  # -> out, P; inputs C: Polyline
# ---------- c_script: C# ----------
    P = new Plane(C[1], C[0], C[2]);
# ---------- end c_script ----------
c_script_2 = CSharpScript(P=poly_spine)  # -> out, A, B, C; inputs P: Polyline
# ---------- c_script_2: C# ----------
    A = P[0];
    B = P[1];
    C = P[2];
# ---------- end c_script_2 ----------
robot_base_plane = Plane(c_script.P)
pt_wristcenter = Point(pt_2)
bool_limitrot = Boolean(limitrot)
pt_wristcenter_2 = Point(pt)
A = Point(c_script_2.A)
B = Point(c_script_2.B)
C = Point(c_script_2.C)

# ---- group: Axis1
robot_base_plane_2 = Plane(robot_base_plane)
bool_limitrot_2 = Boolean(bool_limitrot)
A_2 = Point(A)
B_2 = Point(B)
C_2 = Point(C)
pt_wristcenter_3 = Point(pt_wristcenter_2)
cp = PlaneClosestPoint(Point=A_2, Plane=robot_base_plane_2)  # -> Point, UVPoint, Distance
cp_2 = PlaneClosestPoint(Point=pt_wristcenter_3, Plane=robot_base_plane_2)  # -> Point, UVPoint, Distance
dist = Distance(PointA=robot_base_plane_2, PointB=cp.Point)
cir = Circle(Plane=robot_base_plane_2, Radius=dist)
robot_base_plane_3 = Plane(robot_base_plane_2)
tan = TangentLines(Point=cp_2.Point, Circle=cir)  # -> Tangent1, Tangent2
axis1 = CSharpScript(B=bool_limitrot_2, P=robot_base_plane_3, L=[tan.Tangent1, tan.Tangent2])  # -> out, R; inputs B: Boolean, P: Plane, L: list of Line
# ---------- axis1: C# ----------
    Interval range = new Interval(-RAD_LIMIT, RAD_LIMIT);

    double plx0 = L[0].To.X - P.Origin.X;
    double plx1 = L[1].To.X - P.Origin.X;
    double ang0 = Vector3d.VectorAngle(P.XAxis, new Vector3d(L[0].To - P.Origin), P);
    if (ang0 > Math.PI) ang0 -= TWO_PI;
    double ang1 = Vector3d.VectorAngle(P.XAxis, new Vector3d(L[1].To - P.Origin), P);
    if (ang1 > Math.PI) ang1 -= TWO_PI;


    double ang;
    if ((plx0 < 0) || (plx1 < 0))
    {
      //pick the point in the +ve quadrant if one of them is -ve
      ang = (plx0 >= 0 ? ang0 : ang1);
      Print("0");
    }
    else if ((plx0 >= 0) && (plx1 >= 0))
    {
      //if both are positive, pick the point with the angle below 0
      ang = Math.Min(ang0, ang1);
      Print("0");
      //double plx = L[0].From.X - P.Origin.X;
      //ang = (plx >= 0 ? Math.Min(ang0, ang1) : Math.Max(ang0, ang1));
    }
    else
    {
      //if both are negative, pick the point with angle above 0. This is out of range.
      ang = Math.Max(ang0, ang1);
      Print("1");
    }

    //apply rotation limits
    if (B)
    {
      ang = (ang > range.Max ? range.Max : ang);
      ang = (ang < range.Min ? range.Min : ang);
    }
    
    R = ang;
# ---------- axis1: C# additional code ----------
  const double TWO_PI = Math.PI * 2;
  const double RAD_LIMIT = Math.PI * 0.5;
# ---------- end axis1 ----------
status_axis1 = Text(axis1.out)
angle_axis1 = Number(axis1.R)

bool_limitrot_3 = Boolean(bool_limitrot)
robot_base_plane_4 = Plane(robot_base_plane)
A_3 = Point(A)
B_3 = Point(B)
C_3 = Point(C)
pt_wristcenter_4 = Point(pt_wristcenter)
cp_3 = PlaneClosestPoint(Point=A_3, Plane=robot_base_plane_4)  # -> Point, UVPoint, Distance
cp_4 = PlaneClosestPoint(Point=pt_wristcenter_4, Plane=robot_base_plane_4)  # -> Point, UVPoint, Distance
dist_2 = Distance(PointA=robot_base_plane_4, PointB=cp_3.Point)
cir_2 = Circle(Plane=robot_base_plane_4, Radius=dist_2)
robot_base_plane_5 = Plane(robot_base_plane_4)
tan_2 = TangentLines(Point=cp_4.Point, Circle=cir_2)  # -> Tangent1, Tangent2
axis1_2 = CSharpScript(B=bool_limitrot_3, P=robot_base_plane_5, L=[tan_2.Tangent1, tan_2.Tangent2])  # -> out, R; inputs B: Boolean, P: Plane, L: list of Line; same code as axis1
angle_axis1_2 = Number(axis1_2.R)

# ----
status_axis1_2 = Text(axis1_2.out)

# ---- group: Axis2
robot_base_plane_6 = Plane(robot_base_plane_2)
deplane_2 = DeconstructPlane(Plane=robot_base_plane_6)  # -> Origin, XAxis, YAxis, ZAxis
wristcenter = Point(pt_wristcenter_3)
C_4 = Point(C_2)
A_4 = Point(A_2)
A_5 = Point(A_4)
rotate = Rotate(Geometry=A_5, Angle=angle_axis1, Plane=robot_base_plane_6)  # -> Geometry, Transform
pl_origin = PlaneOrigin(Base=robot_base_plane_6, Origin=rotate.Geometry)
cp_5 = PlaneClosestPoint(Point=wristcenter, Plane=pl_origin)  # -> Point, UVPoint, Distance
addition_2 = Addition(A=rotate.Geometry, B=deplane_2.ZAxis)
B_4 = Point(B_2)
panel_2 = Panel("15*Pi/180 to 165*Pi/180")
pl_3pt = Plane3Pt(PointA=rotate.Geometry, PointB=cp_5.Point, PointC=addition_2)
vec2pt = Vector2Pt(PointA=A_4, PointB=B_4, Unitize=False)  # -> Vector, Length
vec2pt_2 = Vector2Pt(PointA=B_4, PointB=C_4, Unitize=False)  # -> Vector, Length
deplane_3 = DeconstructPlane(Plane=pl_3pt)  # -> Origin, XAxis, YAxis, ZAxis
arc = Arc(Plane=pl_3pt, Radius=vec2pt.Length, Angle=panel_2)  # -> Arc, Length
activepln = Plane(pl_3pt)
circle = CircleCNR(Center=wristcenter, Normal=deplane_3.ZAxis, Radius=vec2pt_2.Length)
axis2 = CSharpScript(B=bool_limitrot_2, A=flatten(arc.Arc), C=flatten(circle))  # -> out, R; inputs B: Boolean, A: list, C: list
# ---------- axis2: C# ----------
    Interval range = new Interval(-RAD_LIMIT, RAD_LIMIT);
    double[] angs = new double[A.Count];
    
    for(int i = 0;i < A.Count;i++)
    {
      Circle aC = new Circle(A[i].Plane, A[i].Radius);
      Line xL = CircleXCircle(aC, C[i]);

      //no intersection
      if (xL.Length == 0)
      {
        angs[i] = Vector3d.VectorAngle(A[i].Plane.YAxis, C[i].Center - A[i].Center, A[i].Plane);
        if (angs[i] > Math.PI) angs[i] -= TWO_PI;
        if (range.IncludesParameter(angs[i])) Print("0");
        else Print("1");
        if (B)
        {
          if (range.Min > angs[i]) angs[i] = range.Min;
          else if (range.Max < angs[i]) angs[i] = range.Max;
        }
        //Print("case1: out of range", angs[i].ToString());
      }
      else
      {
        double param0, param1;
        aC.ClosestParameter(xL.From, out param0);
        aC.ClosestParameter(xL.To, out param1);
        bool chk0 = A[i].AngleDomain.IncludesParameter(param0);
        bool chk1 = A[i].AngleDomain.IncludesParameter(param1);

        //single intersection
        if (!chk0 && chk1)
        {
          angs[i] = Vector3d.VectorAngle(A[i].Plane.YAxis, xL.To - A[i].Center, A[i].Plane);
          if (angs[i] > Math.PI) angs[i] -= TWO_PI;
          Print("0");
          //Print("case2: only 1 good");
        }
        else if (chk0 && !chk1)
        {
          angs[i] = Vector3d.VectorAngle(A[i].Plane.YAxis, xL.From - A[i].Center, A[i].Plane);
          if (angs[i] > Math.PI) angs[i] -= TWO_PI;
          Print("0");
          //Print("case3: only 1 good");
        }
        else if (chk0 && chk1)
        {
          //multiple intersection
          double ang0 = Vector3d.VectorAngle(A[i].Plane.YAxis, xL.From - A[i].Center, A[i].Plane);
          double ang1 = Vector3d.VectorAngle(A[i].Plane.YAxis, xL.To - A[i].Center, A[i].Plane);
          if (ang0 > Math.PI) ang0 -= TWO_PI;
          if (ang1 > Math.PI) ang1 -= TWO_PI;
          if (i == 0) angs[i] = (Math.Abs(ang0) < Math.Abs(ang1) ? ang0 : ang1);
          else angs[i] = (Math.Abs(ang0 - angs[i - 1]) < Math.Abs(ang1 - angs[i - 1]) ? ang0 : ang1);
          Print("0");
          //Print("case4: both good");
        }
        else if (!chk0 && !chk1)
        {
          //both are outside arc
          double ang0 = Vector3d.VectorAngle(A[i].Plane.YAxis, xL.From - A[i].Center, A[i].Plane);
          double ang1 = Vector3d.VectorAngle(A[i].Plane.YAxis, xL.To - A[i].Center, A[i].Plane);
          if (ang0 > Math.PI) ang0 -= TWO_PI;
          if (ang1 > Math.PI) ang1 -= TWO_PI;
          if (i == 0) angs[i] = (Math.Abs(ang0) < Math.Abs(ang1) ? ang0 : ang1);
          else angs[i] = (Math.Abs(ang0 - angs[i - 1]) < Math.Abs(ang1 - angs[i - 1]) ? ang0 : ang1);
          //Print("case5: out of range, sub-zero");
          if (range.IncludesParameter(angs[i])) Print("0");
          else Print("1");
          if (B)
          {
            if (range.Min > angs[i]) angs[i] = range.Min;
            else if (range.Max < angs[i]) angs[i] = range.Max;
          }
        }
      }
    }

    R = angs;
# ---------- axis2: C# additional code ----------
  const double TWO_PI = Math.PI * 2;
  const double RAD_LIMIT = Math.PI * 75.0 / 180.0;
  
  public Line CircleXCircle(Circle cA, Circle cB)
  {
    //test planes for coplanarity
    Double dist = Math.Abs(cA.Plane.DistanceTo(cB.Plane.Origin));
    dist += Math.Abs(cA.Plane.DistanceTo(cB.Plane.Origin + cB.Plane.XAxis));
    dist += Math.Abs(cA.Plane.DistanceTo(cB.Plane.Origin + cB.Plane.YAxis));

    //if planes are not coplanar, solve by PlaneXPlane + CircleXLine
    if (dist > 0.01)
    {
      Line xL0 = new Line();
      Rhino.Geometry.Intersect.Intersection.PlanePlane(cA.Plane, cB.Plane, out xL0);
      if (xL0 == Line.Unset) return Line.Unset;
      Point3d xpt0, xpt1;
      Double dbl0, dbl1;
      Rhino.Geometry.Intersect.Intersection.LineCircle(xL0, cA, out dbl0, out xpt0, out dbl1, out xpt1);
      return new Line(xpt0, xpt1);
    }

    //make intersection plane
    Line cL = new Line(cA.Center, cB.Center);
    Vector3d xvect = cL.Direction;
    Vector3d yvect = xvect;
    yvect.Rotate(Math.PI / 2, cA.Plane.ZAxis);
    Plane xpln = new Plane(cA.Center, xvect, yvect);
    //do the math
    Double d = xpln.Origin.DistanceTo(cB.Center);
    Double rA = cA.Radius;
    Double rB = cB.Radius;
    Double x = (Math.Pow(rA, 2) + Math.Pow(d, 2) - Math.Pow(rB, 2)) / (d * 2);
    Double y = Math.Sqrt(Math.Pow(rA, 2) - Math.Pow(x, 2));
    return new Line(xpln.PointAt(x, y), xpln.PointAt(x, -y));
  }
# ---------- end axis2 ----------
path_mapper = PathMapper(axis2.R, source="{A;B}(N)", target="{A;N}")
path_mapper_2 = PathMapper(axis2.out, source="{A;B}(N)", target="{A;N}")
status_axis2 = Text(path_mapper_2)
angle_axis2 = Number(path_mapper)

robot_base_plane_7 = Plane(robot_base_plane_4)
A_6 = Point(A_3)
rotate_2 = Rotate(Geometry=A_6, Angle=angle_axis1_2, Plane=robot_base_plane_7)  # -> Geometry, Transform
deplane_4 = DeconstructPlane(Plane=robot_base_plane_7)  # -> Origin, XAxis, YAxis, ZAxis
wristcenter_2 = Point(pt_wristcenter_4)
pl_origin_2 = PlaneOrigin(Base=robot_base_plane_7, Origin=rotate_2.Geometry)
cp_6 = PlaneClosestPoint(Point=wristcenter_2, Plane=pl_origin_2)  # -> Point, UVPoint, Distance
addition_3 = Addition(A=rotate_2.Geometry, B=deplane_4.ZAxis)
A_7 = Point(A_3)
B_5 = Point(B_3)
C_5 = Point(C_3)
pl_3pt_2 = Plane3Pt(PointA=rotate_2.Geometry, PointB=cp_6.Point, PointC=addition_3)
vec2pt_3 = Vector2Pt(PointA=A_7, PointB=B_5, Unitize=False)  # -> Vector, Length
deplane_5 = DeconstructPlane(Plane=pl_3pt_2)  # -> Origin, XAxis, YAxis, ZAxis
vec2pt_4 = Vector2Pt(PointA=B_5, PointB=C_5, Unitize=False)  # -> Vector, Length
arc_2 = Arc(Plane=pl_3pt_2, Radius=vec2pt_3.Length, Angle=panel_2)  # -> Arc, Length
activepln_2 = Plane(pl_3pt_2)
circle_2 = CircleCNR(Center=wristcenter_2, Normal=deplane_5.ZAxis, Radius=vec2pt_4.Length)
axis2_2 = CSharpScript(B=bool_limitrot_3, A=flatten(arc_2.Arc), C=flatten(circle_2))  # -> out, R; inputs B: Boolean, A: list, C: list; same code as axis2
path_mapper_3 = PathMapper(axis2_2.R, source="{A;B}(N)", target="{A;N}")
path_mapper_4 = PathMapper(axis2_2.out, source="{A;B}(N)", target="{A;N}")
status_axis2_2 = Text(path_mapper_4)
angle_axis2_2 = Number(path_mapper_3)

# ---- group: Axis3
C_6 = Point(C_2)
A_8 = Point(A_2)
B_6 = Point(B_2)
elbow = CSharpScript(P=pl_3pt, D=vec2pt.Length, R=angle_axis2)  # -> out, X; inputs P: Plane, D: Double, R: Double
# ---------- elbow: C# ----------
    Line ln = new Line(P.Origin, P.YAxis, D);
    ln.Transform(Transform.Rotation(R, P.ZAxis, P.Origin));
    X = ln.To;
# ---------- end elbow ----------
comp = CSharpScript(A=A_8, B=B_6, C=C_6)  # -> out, R; inputs A: Point3d, B: Point3d, C: Point3d
# ---------- comp: C# ----------
    //compensation angle for the slight incline between elbow and wrist
    Vector3d dir0 = C - B;
    Vector3d dir1 = new Point3d(C.X, C.Y, B.Z) - B;
    R = Vector3d.VectorAngle(dir0, dir1);
# ---------- end comp ----------
pl_origin_3 = PlaneOrigin(Base=pl_3pt, Origin=elbow.X)
addition_4 = Addition(A=angle_axis2, B=comp.R)
wristcenter_3 = Point(pt_wristcenter_3)
rotate_3 = Rotate(Geometry=pl_origin_3, Angle=addition_4, Plane=pl_origin_3)  # -> Geometry, Transform
axis3 = CSharpScript(B=bool_limitrot_2, P=rotate_3.Geometry, X=wristcenter_3)  # -> out, R; inputs B: Boolean, P: Plane, X: Point3d
# ---------- axis3: C# ----------
    Interval range = new Interval(-RAD_LIMIT, RAD_LIMIT);
    double ang = Vector3d.VectorAngle(P.XAxis, new Vector3d(X - P.Origin), P);
    if (ang > Math.PI) ang -= TWO_PI;
    
    //apply rotation limits
    if (!range.IncludesParameter(ang)) Print("1");
    else Print("0");
    if (B)
    {
      ang = (ang > range.Max ? range.Max : ang);
      ang = (ang < range.Min ? range.Min : ang);  
    }
    R = ang;
# ---------- axis3: C# additional code ----------
  const double TWO_PI = Math.PI * 2;
  const double RAD_LIMIT = Math.PI * 90.0 / 180.0;
# ---------- end axis3 ----------
activepln_3 = Plane(rotate_3.Geometry)
status_axis3 = Text(axis3.out)
angle_axis3 = Number(axis3.R)

C_7 = Point(C_3)
A_9 = Point(A_3)
B_7 = Point(B_3)
elbow_2 = CSharpScript(P=pl_3pt_2, D=vec2pt_3.Length, R=angle_axis2_2)  # -> out, X; inputs P: Plane, D: Double, R: Double; same code as elbow
comp_2 = CSharpScript(A=A_9, B=B_7, C=C_7)  # -> out, R; inputs A: Point3d, B: Point3d, C: Point3d; same code as comp
pl_origin_4 = PlaneOrigin(Base=pl_3pt_2, Origin=elbow_2.X)
addition_5 = Addition(A=angle_axis2_2, B=comp_2.R)
wristcenter_4 = Point(pt_wristcenter_4)
rotate_4 = Rotate(Geometry=pl_origin_4, Angle=addition_5, Plane=pl_origin_4)  # -> Geometry, Transform
activepln_4 = Plane(rotate_4.Geometry)
axis3_2 = CSharpScript(B=bool_limitrot_3, P=rotate_4.Geometry, X=wristcenter_4)  # -> out, R; inputs B: Boolean, P: Plane, X: Point3d; same code as axis3
status_axis3_2 = Text(axis3_2.out)
angle_axis3_2 = Number(axis3_2.R)

# ---- group: tFrame Orientation Decision
target_frame_4 = Plane(target_frame_3)
angle_axis3_3 = Number(angle_axis3)
angle_axis3_4 = Number(angle_axis3_2)
activepln_5 = Plane(activepln_3)
activepln_6 = Plane(activepln_4)
wristcenter_5 = Point(wristcenter_3)
wristcenter_6 = Point(wristcenter_4)
status_axis3_3 = Text(status_axis3)
status_axis3_4 = Text(status_axis3_2)
decide = CSharpScript(aP0=activepln_5, wC0=wristcenter_5, aP1=activepln_6, tF=target_frame_4, wC1=wristcenter_6)  # -> out, fF, R; inputs aP0: Plane, wC0: Point3d, aP1: Plane, tF: Plane, wC1: Point3d
# ---------- decide: C# ----------
    Vector3d tVect = tF.Origin - wC0;
    double ang0 = Vector3d.VectorAngle(aP0.Origin - wC0, tVect);
    double ang1 = Vector3d.VectorAngle(aP1.Origin - wC1, tVect);
    int data = 0;
    if (ang0 >= HALF_PI) data = 0; //preference to ang0
    else if (ang0 < HALF_PI && ang1 >= HALF_PI) data = 1;
    else if (ang0 < HALF_PI && ang1 < HALF_PI) data = (ang0 > ang1 ? 0 : 1);

    Plane fPln = tF;
    if (data == 1) fPln.Rotate(Math.PI, fPln.YAxis);
    fF = fPln;
    R = data;
# ---------- decide: C# additional code ----------
  const double HALF_PI = Math.PI * 0.5;
# ---------- end decide ----------
tforientation = Integer(decide.R)
target_frame_5 = Plane(decide.fF)
gate = CSharpScript(X=decide.R, A=angle_axis3_3, B=angle_axis3_4)  # -> out, R; inputs X: Int32
# ---------- gate: C# ----------
    if (X == 0) R = A;
    else R = B;
# ---------- end gate ----------
gate_2 = CSharpScript(X=decide.R, A=activepln_5, B=activepln_6)  # -> out, R; inputs X: Int32; same code as gate
gate_3 = CSharpScript(X=decide.R, A=wristcenter_5, B=wristcenter_6)  # -> out, R; inputs X: Int32; same code as gate
gate_4 = CSharpScript(X=decide.R, A=status_axis3_3, B=status_axis3_4)  # -> out, R; inputs X: Int32; same code as gate
status_axis3_5 = Text(gate_4.R)
angle_axis3_5 = Number(gate.R)
activepln_7 = Plane(gate_2.R)

# ---- group: DataFormatter
robot_base_plane_8 = Plane(robot_base_plane)
tforientation_2 = Integer(tforientation)
gate_5 = CSharpScript(X=tforientation_2, A=angle_axis1, B=angle_axis1_2)  # -> out, R; inputs X: Int32; same code as gate
gate_6 = CSharpScript(X=tforientation_2, A=status_axis1, B=status_axis1_2)  # -> out, R; inputs X: Int32; same code as gate
lng = ListLength(List=flatten(gate_5.R))
angle_axis1_3 = Number(gate_5.R)
match = MatchTree(Tree=gate_6.R, Guide=gate_5.R)
repeat = RepeatData(Data=robot_base_plane_8, Length=lng)
unflatten = UnflattenTree(Tree=repeat, Guide=match)
merge = Merge(Data1=unflatten, Data2=match, Data3=gate_5.R)
path_mapper_5 = PathMapper(merge, source="{A;B}", target="{0;B}")

tforientation_3 = Integer(tforientation)
gate_7 = CSharpScript(X=tforientation_3, A=activepln, B=activepln_2)  # -> out, R; inputs X: Int32; same code as gate
gate_8 = CSharpScript(X=tforientation_3, A=status_axis2, B=status_axis2_2)  # -> out, R; inputs X: Int32; same code as gate
gate_9 = CSharpScript(X=tforientation_3, A=angle_axis2, B=angle_axis2_2)  # -> out, R; inputs X: Int32; same code as gate
match_2 = MatchTree(Tree=gate_8.R, Guide=gate_9.R)
merge_2 = Merge(Data1=gate_7.R, Data2=match_2, Data3=gate_9.R)
path_mapper_6 = PathMapper(merge_2, source="{A;B}", target="{1;B}")
angle_axis2_3 = Number(gate_9.R)

# ----
target_frame_6 = ClusterOutput(target_frame_5)

# ---- group: Axis4
activepln_8 = Plane(activepln_7)
target_frame_7 = Plane(target_frame_5)
wristcenter_7 = Point(gate_3.R)
angle_axis3_6 = Number(angle_axis3_5)
pl_origin_5 = PlaneOrigin(Base=activepln_8, Origin=wristcenter_7)
rotate_5 = Rotate(Geometry=pl_origin_5, Angle=angle_axis3_6, Plane=pl_origin_5)  # -> Geometry, Transform
deplane_6 = DeconstructPlane(Plane=rotate_5.Geometry)  # -> Origin, XAxis, YAxis, ZAxis
line = LineSDL(Start=deplane_6.Origin, Direction=deplane_6.YAxis, Length=1)
pl_origin_6 = PlaneOrigin(Base=target_frame_7, Origin=wristcenter_7)
rotax = RotateAxis(Geometry=rotate_5.Geometry, Angle=1.570796327, Axis=line)  # -> Geometry, Transform
ppx = PlanePlane(PlaneA=rotax.Geometry, PlaneB=pl_origin_6)
axis4 = CSharpScript(X=bool_limitrot_2, B=flatten(ppx), P=flatten(rotax.Geometry))  # -> graft(out), graft(R); inputs X: Boolean, B: list of Vector3d, P: list of Plane
# ---------- axis4: C# ----------
    Interval range = new Interval(-RAD_LIMIT, RAD_LIMIT);
    double[] angs = new double[B.Count];

    for(int i = 0;i < B.Count;i++)
    {
      //find both angles
      double ang0 = Vector3d.VectorAngle(P[i].XAxis, B[i], P[i]);
      if (ang0 > Math.PI) ang0 -= TWO_PI;
      double ang1 = Vector3d.VectorAngle(P[i].XAxis, -B[i], P[i]);
      if (ang1 > Math.PI) ang1 -= TWO_PI;
      
      string status = "0";
      //first angle: pick the lesser
      if (i == 0) angs[i] = (Math.Abs(ang0) < Math.Abs(ang1) ? ang0 : ang1); 
      else //subsequent angles
      {
        //easy choice if any of the options is out of range
        if (!range.IncludesParameter(ang0) && range.IncludesParameter(ang1)) angs[i] = ang1;
        else if (!range.IncludesParameter(ang1) && range.IncludesParameter(ang0)) angs[i] = ang0;
        else if (!range.IncludesParameter(ang0) && !range.IncludesParameter(ang1)) 
        {
          //if both are out of range, pick the one that requires lesser magnitude change from previous angle
          angs[i] = (Math.Abs(ang0 - angs[i - 1]) < Math.Abs(ang1 - angs[i - 1]) ? ang0 : ang1);
          status = "1";
        }
        else
        {
          //if both are in range, pick the one that requires lesser magnitude change from previous angle
          angs[i] = (Math.Abs(ang0 - angs[i - 1]) < Math.Abs(ang1 - angs[i - 1]) ? ang0 : ang1);
        }
      }
      Print(status);
    }
    R = angs;
# ---------- axis4: C# additional code ----------
  const double TWO_PI = Math.PI * 2;
  const double RAD_LIMIT = Math.PI * 150.0 / 180.0;
# ---------- end axis4 ----------
path_mapper_7 = PathMapper(axis4.R, source="{A;B;C}", target="{A;C}")
path_mapper_8 = PathMapper(axis4.out, source="{A;B;C}", target="{A;C}")
tf_wristcent = Plane(pl_origin_6)
status_axis4 = Text(path_mapper_8)
angle_axis4 = Number(path_mapper_7)
activepln_9 = Plane(rotax.Geometry)

# ---- group: DataFormatter
status = Text(status_axis3_5)
activepln_10 = Plane(gate_2.R)
angle = Number(gate.R)
match_3 = MatchTree(Tree=status, Guide=angle)
merge_3 = Merge(Data1=activepln_10, Data2=match_3, Data3=angle)
path_mapper_9 = PathMapper(merge_3, source="{A;B}", target="{2;B}")

activepln_11 = Plane(activepln_9)
status_2 = Text(status_axis4)
angle_2 = Number(angle_axis4)
match_4 = MatchTree(Tree=status_2, Guide=angle_2)
merge_4 = Merge(Data1=activepln_11, Data2=match_4, Data3=angle_2)
path_mapper_10 = PathMapper(merge_4, source="{A;B}", target="{3;B}")

# ---- group: Axis5
tf_wristcent_2 = Plane(tf_wristcent)
rotate_6 = Rotate(Geometry=activepln_9, Angle=angle_axis4, Plane=activepln_9)  # -> Geometry, Transform
axis5 = CSharpScript(P=rotate_6.Geometry, T=tf_wristcent_2)  # -> out, R, X; inputs B: Boolean, P: Plane, T: Plane
# ---------- axis5: C# ----------
    Interval range = new Interval(-RAD_LIMIT, RAD_LIMIT); 
    Plane temPln = P;
    temPln.Rotate(-Math.PI / 2, temPln.YAxis);
    Line xL = new Line();
    Rhino.Geometry.Intersect.Intersection.PlanePlane(temPln, T, out xL);
    double ang = Vector3d.VectorAngle(xL.Direction, P.YAxis, temPln);
    if (ang > Math.PI) ang -= TWO_PI;
    
    if (range.IncludesParameter(ang)) Print("0");
    else Print("1");
    if (B)
    {
      ang = (ang > range.Max ? range.Max : ang);
      ang = (ang < range.Min ? range.Min : ang);
    }
    
    R = ang;
    X = new Line(xL.From, xL.Direction, 15);
# ---------- axis5: C# additional code ----------
  const double TWO_PI = Math.PI * 2;
  const double RAD_LIMIT = Math.PI * 0.5;
# ---------- end axis5 ----------
status_axis5 = Text(axis5.out)
angle_axis5 = Number(axis5.R)
activepln_12 = Plane(rotate_6.Geometry)

# ---- group: Axis6
deplane_7 = DeconstructPlane(Plane=activepln_12)  # -> Origin, XAxis, YAxis, ZAxis
tf_wristcent_3 = Plane(tf_wristcent)
line_2 = LineSDL(Start=deplane_7.Origin, Direction=deplane_7.XAxis, Length=1)
rotax_2 = RotateAxis(Geometry=activepln_12, Angle=angle_axis5, Axis=line_2)  # -> Geometry, Transform
axis6 = CSharpScript(B=bool_limitrot_2, P=rotax_2.Geometry, T=tf_wristcent_3)  # -> out, R, D; inputs B: Boolean, P: Plane, T: Plane
# ---------- axis6: C# ----------
    Interval range = new Interval(-RAD_LIMIT, RAD_LIMIT);
    double ang = Vector3d.VectorAngle(P.YAxis, T.YAxis, P);
    if (ang > Math.PI) ang -= TWO_PI;
    if (range.IncludesParameter(ang)) Print("0");
    else Print("1");
    
    //apply rotation limits
    double xang = ang;
    if (B)
    {
      ang = (ang > range.Max ? range.Max : ang);
      ang = (ang < range.Min ? range.Min : ang);
    }
    
    P.Transform(Transform.Rotation(ang, P.ZAxis, P.Origin));
    R = ang;
    D = P;
# ---------- axis6: C# additional code ----------
  const double TWO_PI = Math.PI * 2;
  const double RAD_LIMIT = Math.PI * 150.0 / 180.0;
# ---------- end axis6 ----------
status_axis6 = Text(axis6.out)
angle_axis6 = Number(axis6.R)
resultframe = Plane(axis6.D)
activepln_13 = Plane(rotax_2.Geometry)

# ---- group: DataFormatter
activepln_14 = Plane(activepln_12)
status_3 = Text(status_axis5)
angle_3 = Number(angle_axis5)
match_5 = MatchTree(Tree=status_3, Guide=angle_3)
merge_5 = Merge(Data1=activepln_14, Data2=match_5, Data3=angle_3)
path_mapper_11 = PathMapper(merge_5, source="{A;B}", target="{4;B}")

# ----
resultframe_2 = ClusterOutput(resultframe)

# ---- group: DataFormatter
activepln_15 = Plane(activepln_13)
status_4 = Text(axis6.out)
angle_4 = Number(angle_axis6)
match_6 = MatchTree(Tree=status_4, Guide=angle_4)
merge_6 = Merge(Data1=activepln_15, Data2=match_6, Data3=angle_4)
path_mapper_12 = PathMapper(merge_6, source="{A;B}", target="{5;B}")

# ----
merge_7 = Merge(
    Data1=path_mapper_5,
    Data2=path_mapper_6,
    Data3=path_mapper_9,
    Data4=path_mapper_10,
    Data5=path_mapper_11,
    Data6=path_mapper_12)
D = ClusterOutput(merge_7)

# ==== cluster Cluster
data = ClusterInput()
bool = ClusterInput()
data_2 = Data(data)
bool_2 = Boolean(bool)
viewer = ParamViewer(data_2)
dispatch = Dispatch(List=viewer, DispatchPattern=flatten(bool_2))  # -> ListA, ListB
lng = ListLength(List=dispatch.ListA)  # -> expr("x/6", Length)
series = Series(Start=0, Step=1, Count=6)
branch = TreeBranch(Tree=data_2, Path=dispatch.ListA, MaintainPaths=True)
series_2 = Series(Start=series, Step=1, Count=lng)  # -> simplify(graft(Series))
match = MatchTree(Tree=branch, Guide=series_2)
T = ClusterOutput(match)

# ==== cluster Cluster_2
data = ClusterInput()
bool = ClusterInput()
data_2 = Data(data)
bool_2 = Boolean(bool)
viewer = ParamViewer(data_2)
dispatch = Dispatch(List=viewer, DispatchPattern=flatten(bool_2))  # -> ListA, ListB
branch = TreeBranch(Tree=data_2, Path=dispatch.ListA, MaintainPaths=False)
path_mapper = PathMapper(branch, source="{A}", target="{0;A}")
data_3 = Data(path_mapper)
data_4 = ClusterOutput(data_3)
